# Grasshopper definition exam1.gh (Grasshopper 1.0.7)
# plug-ins: calculate

line = Line(Line((100, 0, 0), (100, 0, 50)))
line_2 = Line(Line((0, 0, 0), (0, 0, 20)))
truss = Truss(Line1=line_2, Line2=line, Segments=Slider(7, range=1..10), Type=Slider(9, range=1..10))  # -> Point, Line
