# Grasshopper definition exam3.gh (Grasshopper 1.0.7)
# plug-ins: gh3

unit_vector = UnitVector(Vector=Vector(0, 0, -1))
panel = Panel(unit_vector)
curve = Curve(<curve referenced from the Rhino model>)
curve_2 = Curve(<curve referenced from the Rhino model>)
curve_3 = Curve(<curve referenced from the Rhino model>)
curve_truss = Curve_truss(Curve=curve, OffSet=Slider(3.515, range=0..20), Type=Slider(1, range=1..6), Segment=Slider(19, range=0..50))  # -> Test, Curve_point, Point, Line, Vector
