# Grasshopper definition exam4.gh (Grasshopper 1.0.7)
# plug-ins: gh4

series = Series(Start=0, Step=5, Count=40)
panel = Panel("""0
97.5
150
197.5
223.5
250""")
brep = Brep(<brep referenced from the Rhino model>)
brep_2 = Brep(<brep referenced from the Rhino model>)
column_arrange = Column_arrange(
    外立面曲面=brep,
    核心筒曲面=brep_2,
    层高表=panel,
    基底标高=Slider(4.048, range=1..10),
    外柱与外立面偏移量=0,
    柱数=Slider(24, range=4..50),
    旋转角度=Slider(240.565, range=0..360))  # -> Column, Beam1, Beam2, Wall
curve = Curve(column_arrange.Column)
curve_2 = Curve(column_arrange.Beam1)
curve_3 = Curve(column_arrange.Beam2)
brep_3 = Brep(column_arrange.Wall)
panel_2 = Panel(curve_2)
