# Grasshopper definition exam5.gh (Grasshopper 1.0.7)
# plug-ins: Export_Pkpm, gh5

series = Series(Start=Slider(0, range=0..100), Step=Slider(27, range=0..50), Count=Slider(46, range=0..100))
brep = Brep(<brep referenced from the Rhino model>)
brep_2 = Brep(<brep referenced from the Rhino model>)
auto_design_software = Auto_Design_Software(
    外立面曲面=brep,
    核心筒曲面=brep_2,
    层高表=series,
    基底标高=Slider(7, range=0..10),
    外柱与外立面偏移量=0,
    柱数=Slider(24, range=4..50),
    核心筒墙间距=Slider(9, range=0..10))  # -> Column, Beam1, Beam2, Wall
path_mapper = PathMapper(source="{A;B;C}", target="{A;B}")
construct_path = ConstructPath(Indices=[Slider(4, range=0..10), Slider(3, range=0..10)])  # -> flatten(Branch)
graft_tree = GraftTree(Tree=auto_design_software.Column, IncludeEmptyLists=True, IncludeNullItems=True)
graft_tree_2 = GraftTree(Tree=auto_design_software.Beam1, IncludeEmptyLists=True, IncludeNullItems=True)
graft_tree_3 = GraftTree(Tree=auto_design_software.Beam2, IncludeEmptyLists=True, IncludeNullItems=True)
graft_tree_4 = GraftTree(Tree=auto_design_software.Wall, IncludeEmptyLists=True, IncludeNullItems=True)
tree_branch = TreeBranch(Tree=path_mapper, Path=construct_path, MaintainPaths=True)
geometry = Geometry(tree_branch)
export_pkpmbeam = Export_PkpmBeam(Stop=Toggle(True), PKPMPath="D:\ECADI\GXYtest\001.jws")
