# Grasshopper definition exam6.gh (Grasshopper 1.0.7)
# plug-ins: Export_Pkpm, gh6

series = Series(Start=Slider(0, range=0..100), Step=Slider(7, range=0..50), Count=Slider(44, range=0..100))
series_2 = Series(Start=Slider(0, range=0..100), Step=Slider(9, range=0..50), Count=Slider(15, range=0..100))
series_3 = Series(Start=Slider(1, range=0..6), Step=Slider(0, range=0..50), Count=Slider(2, range=0..100))
series_4 = Series(Start=Slider(7, range=0..100), Step=Slider(0, range=0..50), Count=Slider(28, range=0..100))
series_5 = Series(Start=Slider(3, range=0..10), Step=Slider(0, range=0..50), Count=Slider(28, range=0..100))
series_6 = Series(Start=Slider(2, range=0..6), Step=Slider(0, range=0..50), Count=Slider(2, range=0..100))
brep = Brep(<brep referenced from the Rhino model>)
brep_2 = Brep(<brep referenced from the Rhino model>)
unit_z = UnitZ(Factor=200)
unit_z_2 = UnitZ(Factor=200)
curve = Curve(<curve referenced from the Rhino model>)
curve_2 = Curve(<curve referenced from the Rhino model>)
extrude = Extrude(Base=curve, Direction=unit_z)
auto_design_software = Auto_Design_Software(
    外立面曲面=brep,
    核心筒曲面=brep_2,
    层高表=series,
    基底标高=Slider(1.594, range=0..10),
    外柱与外立面偏移量=0,
    核心筒柱数=Slider(8, range=4..50),
    角柱数=Slider(1, range=0..10),
    腰部和环带桁架楼层表=series_2,
    腰部桁架段数=series_4,
    腰部桁架类型=series_3,
    环带桁架段数=series_5,
    环带桁架类型=series_6)  # -> Column, Beam1, Beam2, Wall, Brace1, Brace2
extrude_2 = Extrude(Base=curve_2, Direction=unit_z_2)
construct_path = ConstructPath(Indices=[Slider(4, range=0..10), Slider(3, range=0..10)])  # -> flatten(Branch)
path_mapper = PathMapper(source="{A;B;C}", target="{A;B}")
graft_tree = GraftTree(Tree=auto_design_software.Column, IncludeEmptyLists=True, IncludeNullItems=True)
graft_tree_2 = GraftTree(Tree=auto_design_software.Beam1, IncludeEmptyLists=True, IncludeNullItems=True)
graft_tree_3 = GraftTree(Tree=auto_design_software.Beam2, IncludeEmptyLists=True, IncludeNullItems=True)
graft_tree_4 = GraftTree(Tree=auto_design_software.Wall, IncludeEmptyLists=True, IncludeNullItems=True)
graft_tree_5 = GraftTree(Tree=auto_design_software.Brace1, IncludeEmptyLists=True, IncludeNullItems=True)
graft_tree_6 = GraftTree(Tree=auto_design_software.Brace2, IncludeEmptyLists=True, IncludeNullItems=True)
tree_branch = TreeBranch(Tree=path_mapper, Path=construct_path, MaintainPaths=True)
geometry = Geometry(tree_branch)
export_pkpmbeam = Export_PkpmBeam(Stop=Toggle(True), PKPMPath="D:\ECADI\GXYtest\001.jws")
